# Grasshopper definition TopologyOptimisation_LMP18.gh (Grasshopper 0.9.76)
# plug-ins: MeshEdit Components, Python Interpreter, Human, Kangaroo Components, LunchBox, Millipede, Weaverbird

number_slider = Slider(8, range=0..10)  # disabled

# ----
# Select support type
# and region
crv = Curve([<curve referenced from the Rhino model> x3])
mat = MillC_StockSupportType(X=True, Y=True, Z=True, RX=True, RY=True, RZ=True)
support = _2DSupportRegion(Boundary=crv, SupportType=mat, AmendExistingSupports=Toggle(True), Displacement=Vector(0, 0, 0))

# ----
# Select shape to Optimize
crv_2 = Curve(<curve referenced from the Rhino model>)
boundary = _2DBoundaryRegion(Boundary=crv_2, IsVoid=False)

crv_3 = Curve(<curve referenced from the Rhino model>)
# Select load force
# and load region
slider = Slider(-60000, range=-1000000..40000.001)
Y = UnitY(Factor=slider)
load = _2DLoadRegion(Boundary=crv_3, Load=Y)

# ----
# create a skeleton surface by substracting  the  holes from the skeleton
# outer closed curve of skeleton
crv_4 = Curve(<curve referenced from the Rhino model>)  # disabled
# holes
# CREATE DEEP PANEL
crv_5 = Curve([<curve referenced from the Rhino model> x242])  # disabled
# reference a specific iso border depending on
# how thick you want your structure to be
crv_6 = Curve([<curve referenced from the Rhino model> x185])  # disabled
# get rid of small pieces
len = Length(Curve=crv_6)  # disabled
boundary_2 = BoundarySurfaces(Edges=crv_4)  # disabled
boundary_3 = BoundarySurfaces(Edges=crv_5)  # disabled
larger = LargerThan(FirstNumber=len, SecondNumber=number_slider)  # -> LargerThan, OrEqualTo; disabled
sdiff = SolidDifference(BrepsA=boundary_2, BrepsB=boundary_3)  # disabled
# 1
# Read the file of Image Skeleton(from Spyder)
# Curve that was
# initially optimized
panel = Panel("C:\Users\Harley Quinn\Desktop\ETH\LMP18\TEST\20180109_142923skeleton .png")  # disabled
cull = CullPattern(List=crv_6, CullPattern=larger.OrEqualTo)  # disabled

# ----
# 2
# Reference surface of IsoBorder
# skeleton surface
srf = Surface(<surface referenced from the Rhino model>)  # disabled
debrep = DeconstructBrep(Brep=srf)  # -> Faces, Edges, Vertices; disabled
join = JoinCurves(Curves=debrep.Edges, Preserve=False)  # disabled
number_slider_2 = Slider(0.3, range=0..1)  # disabled
pcol = PolylineCollapse(Polyline=join, Tolerance=number_slider_2)  # -> Polyline, Count; disabled
number_slider_3 = Slider(6, range=0..10)  # disabled
divlength = DivideLength(Curve=pcol.Polyline, Length=number_slider_3)  # -> Points, Tangents, Parameters; disabled
boundary_4 = BoundarySurfaces(Edges=pcol.Polyline)  # disabled

crv_7 = Curve(<curve referenced from the Rhino model>)  # disabled

# ----
# Select Half of the model to have symmetrical results
#  and then mirror according to the correct plane
crv_8 = Curve(crv_2)
explode = Explode(Curve=crv_8, Recursive=True)  # -> Segments, Vertices
item = ListItem(List=explode.Vertices, Index=0, Wrap=True)
pop2d = Populate2D(Region=crv_8, Count=Slider(50, range=0..13100), Seed=1)
xz = XZPlane(Origin=item)
mirror = Mirror(Geometry=pop2d, Plane=xz)  # -> Geometry, Transform
merge = Merge(Data1=pop2d, Data2=mirror.Geometry)  # -> flatten(Result)

# ----
# obj exporter
pdecon = Deconstruct(Point=explode.Vertices)  # -> XComponent, YComponent, ZComponent
dam = DataDam(DataA=[boundary, load, support], BufferDelay=10000000, BufferMode=0)

# ----
# Resolution in X
slider_2 = Slider(100, range=0..500)
# MILLIPEDE
topostruct_2d = Topostruct2DModel(ModelComponents=dam, XResolution=slider_2)  # -> FEModel, CellCentres, CellSize
# Solver 2D
topostruct_2d_solver = Topostruct2DSolver(
    FEModel=topostruct_2d.FEModel,
    SelfWeightCoefficient=0,
    OptimizationIterations=Slider(25, range=0..90),
    Smoothing=0.1,
    Penalization=3,
    TargetDensity=Slider(0.35, range=0..1),
    MinimumDensity=0.001,
    DeleteThreshold=0.5,
    PeriodicX=False,
    PeriodicY=False,
    LoadCase=0,
    AllCases=True,
    CompliantMechanism=False)  # -> FEModel, MaxDeflection

img = ImportImage(File=panel, Rectangle=crv_7)  # disabled
concat = Concatenate(
    FragmentA="v ",
    FragmentB=graft(pdecon.XComponent),
    FragmentC=" ",
    FragmentD=graft(pdecon.YComponent),
    FragmentE=" ",
    FragmentF=graft(pdecon.ZComponent))  # -> flatten(Result)
cull_i = CullIndex(List=concat, Indices=-1, Wrap=True)  # -> simplify(List)
panel_2 = Panel(",")  # disabled
number_slider_4 = Slider(250, range=0..255)  # disabled

demesh = DeconstructMesh(Mesh=img)  # -> Vertices, Faces, Colours, Normals; disabled
split = TextSplit(Text=demesh.Colours, Separators=panel_2)  # disabled
# Check if the color of pixel is
# white and create point
item_2 = ListItem(List=simplify(split), Index=0, Wrap=True)  # disabled
larger_2 = LargerThan(FirstNumber=item_2, SecondNumber=number_slider_4)  # -> LargerThan, OrEqualTo; disabled
dispatch = Dispatch(List=demesh.Vertices, DispatchPattern=flatten(larger_2.LargerThan))  # -> ListA, ListB; disabled
number_slider_5 = Slider(5, range=0..10)  # disabled
pt = Point(flatten(dispatch.ListA))  # disabled
duppt = RemoveDuplicatePts(Points=pt, Tolerance=number_slider_5)  # disabled

# ----
# This will export in the  same folder  as the gh file
# a Mesh plane that corresponds to your input curve
panel_3 = Panel("f 1 2 3 4")
panel_4 = Panel(demesh.Vertices)  # disabled

# ----
# Divide initial shape accordingly
# for a well structured mesh
number_slider_6 = Slider(6, range=0..10)  # disabled
divlength_2 = DivideLength(Curve=crv_7, Length=number_slider_6)  # -> Points, Tangents, Parameters; disabled
pt_2 = Point(flatten(divlength_2.Points))  # disabled

merge_2 = Merge(Data1=flatten("o object_1"), Data2=flatten(cull_i), Data3=flatten(panel_3))
python = PythonScript(lines=merge_2)  # -> out, a; inputs lines: list
# ---------- python: Python ----------
file = open("meshPlane.obj","w") 

for i in range(len(lines)):
    if  i!=0:
        file.write('\n' )
    file.write(lines[i]) 

 
file.close()
# ---------- end python ----------

pt_3 = Point(merge)
division = Division(A=Slider(0, range=0..4), B=topostruct_2d_solver.MaxDeflection)
stress_lines = StressLines(FEModel=topostruct_2d_solver.FEModel, Seeds=pt_3)  # -> Curves1, Curves2
_2d_iso_contour = _2DIsoContour(FEModel=topostruct_2d_solver.FEModel, Deflection=0, IsoContourValue=Slider(0.277, range=0..1))

# ----
# Merge all points and  create mesh
merge_3 = Merge(Data1=duppt, Data2=pt_2, Data3=flatten(divlength.Points))  # -> flatten(Result); disabled
del = DelaunayMesh(Points=merge_3, Plane=PlaneXY(0, 0, 0))  # disabled

merge_4 = Merge(Data1=pt, Data2=pt_2)  # disabled
# STRESS LINES
# TENTION
crv_9 = Curve([stress_lines.Curves2, stress_lines.Curves1])
# ISO BORDER
crv_10 = Curve(_2d_iso_contour)
# STRESS LINES
# COMPRESSION
crv_11 = Curve([stress_lines.Curves2, stress_lines.Curves1])
crv_cp = CurveClosestPoint(Point=merge_4, Curve=crv_7)  # -> Point, Parameter, Distance; disabled
number_slider_7 = Slider(0.2, range=0..1)  # disabled
cluster = Cluster(fe=topostruct_2d_solver.FEModel, D=division)
dist = Distance(PointA=merge_4, PointB=crv_cp.Point)  # -> simplify(Distance); disabled

demesh_2 = DeconstructMesh(Mesh=del)  # -> Vertices, Faces, Colours, Normals; disabled
number_slider_8 = Slider(0.5, range=0..1)  # disabled
facen = FaceNormals(Mesh=del)  # -> Centers, Normals; disabled
# check  which faces belong to the skeleton/
# DISPATCH  TWO MESHES
srf_cp = SurfaceClosestPoint(Point=facen.Centers, Surface=srf)  # -> Point, UVPoint, Distance; disabled
smaller = SmallerThan(FirstNumber=srf_cp.Distance, SecondNumber=number_slider_8)  # -> SmallerThan, OrEqualTo; disabled
dispatch_2 = Dispatch(List=demesh_2.Faces, DispatchPattern=smaller.OrEqualTo)  # -> ListA, ListB; disabled

# ----
# Output Mesh
mesh = Mesh(cluster)  # disabled
multiplication = Multiplication(A=dist, B=number_slider_7)  # disabled
demesh_3 = DeconstructMesh(Mesh=mesh)  # -> Vertices, Faces, Colours, Normals; disabled

# ----
# BITMAP EXPORT
panel_5 = Panel("C:\Users\Harley Quinn\Desktop\ETH\LMP18\TEST\myBitmap2.bmp")  # disabled
addition = Addition(A=slider_2, B=1)  # disabled
# Export bitmap
lng = ListLength(List=demesh_3.Colours)  # disabled
division_2 = Division(A=lng, B=addition)  # disabled
python_2 = PythonScript(x=addition, y=division_2, cols=demesh_3.Colours, path=panel_5)  # -> out, img; inputs x: Int32, y: Int32, cols: list; disabled
# ---------- python_2: Python ----------
import System
import rhinoscriptsyntax as rs

newCols=[]
size = y*x
index = 0
count=0
img = System.Drawing.Bitmap(x,y)
print x,y
for j in range (y):

    for i in range(x):
        #print (cols[i+i*j])
        count=count+1
        index = ((x-i-1))+(j)*x
        print "col index",index
        print "x", x-1
        print "y", j
        
        newCols.append(cols[index])
        img.SetPixel(i,j,cols[index])
print newCols
newCols.reverse()
print newCols

for j in range(y):
    for i in range(x):
        index = (i)+(j)*x
        img.SetPixel(i,j, newCols[index])

print img.Size
print count
img.Save(path)
# ---------- end python_2 ----------

Z = UnitZ(Factor=multiplication)  # disabled
move = Move(Geometry=pt, Motion=Z)  # -> Geometry, Transform; disabled
number_slider_9 = Slider(50, range=0..100)  # disabled
panel_6 = Panel(",")  # disabled
split_2 = TextSplit(Text=demesh_3.Colours, Separators=panel_6)  # disabled
item_3 = ListItem(List=split_2, Index=0, Wrap=True)  # -> simplify(flatten(Item)); disabled
panel_7 = Panel(item_3)  # disabled
smaller_2 = SmallerThan(FirstNumber=item_3, SecondNumber=number_slider_9)  # -> SmallerThan, OrEqualTo; disabled
python_3 = PythonScript(x=smaller_2.OrEqualTo)  # -> out, newCols; inputs x: list; disabled
# ---------- python_3: Python ----------
newCols=[]

for i in range(len(x)):
    if x[i]==True:
        newCols.append(0)
    else:
        newCols.append(255)
# ---------- end python_3 ----------

deface = DeconstructFace(Face=dispatch_2.ListA)  # -> CornerA, CornerB, CornerC, CornerD; disabled
item_4 = ListItem(List=demesh_2.Vertices, Index=deface.CornerB, Wrap=True)  # disabled
item_5 = ListItem(List=demesh_2.Vertices, Index=deface.CornerC, Wrap=True)  # disabled
item_6 = ListItem(List=demesh_2.Vertices, Index=deface.CornerA, Wrap=True)  # disabled
ln = Line(StartPoint=item_4, EndPoint=item_5)  # disabled
ln_2 = Line(StartPoint=item_5, EndPoint=item_6)  # disabled
ln_3 = Line(StartPoint=item_6, EndPoint=item_4)  # disabled
line = Line([ln, ln_2, ln_3])  # disabled
dupln = RemoveDuplicateLines(Lines=line, Tolerance=0.01)  # disabled
wbweave = WeaverbirdsMeshFromLinesWeaveBack(Lines=dupln, MaximumValence=4)  # disabled
# SKELETON
# bake & rework the mesh  structure for better results:
# aim for clear skeleton line
# reasign the  curves to the component
wbedges = WeaverbirdsMeshEdges(MeshOrPolylines=wbweave)  # disabled

deface_2 = DeconstructFace(Face=dispatch_2.ListB)  # -> CornerA, CornerB, CornerC, CornerD; disabled
item_7 = ListItem(List=demesh_2.Vertices, Index=deface_2.CornerA, Wrap=True)  # disabled
item_8 = ListItem(List=demesh_2.Vertices, Index=deface_2.CornerB, Wrap=True)  # disabled
item_9 = ListItem(List=demesh_2.Vertices, Index=deface_2.CornerC, Wrap=True)  # disabled
ln_4 = Line(StartPoint=item_7, EndPoint=item_8)  # disabled
ln_5 = Line(StartPoint=item_8, EndPoint=item_9)  # disabled
ln_6 = Line(StartPoint=item_9, EndPoint=item_7)  # disabled
line_2 = Line([ln_4, ln_5, ln_6])  # disabled
dupln_2 = RemoveDuplicateLines(Lines=line_2, Tolerance=0.01)  # disabled
# REST MESH
wbweave_2 = WeaverbirdsMeshFromLinesWeaveBack(Lines=dupln_2, MaximumValence=4)  # disabled

sort = SortList(Keys=python_3.newCols)  # -> Keys, ValuesA; disabled
# Remapping to the desired depth
item_10 = ListItem(List=sort.Keys, Index=-1, Wrap=True)  # disabled
item_11 = ListItem(List=sort.Keys, Index=0, Wrap=True)  # disabled
panel_8 = Panel("0 to 2")  # disabled
dom = ConstructDomain(DomainStart=item_11, DomainEnd=item_10)  # disabled
remap = RemapNumbers(Value=python_3.newCols, Source=dom, Target=panel_8)  # -> Mapped, Clipped; disabled

Z_2 = UnitZ(Factor=remap.Mapped)  # -> flatten(UnitVector); disabled
move_2 = Move(Geometry=demesh_3.Vertices, Motion=Z_2)  # -> Geometry, Transform; disabled
# Smoothen  final mesh
number_slider_10 = Slider(4, range=0..10)  # disabled
conmesh = ConstructMesh(Vertices=move_2.Geometry, Faces=demesh_3.Faces)  # disabled
crv_12 = Curve(wbedges)  # disabled
wblaplace = WeaverbirdsLaplacianSmoothing(MeshCurves=conmesh, Level=number_slider_10, SmoothNakedEdges=1, Thin=1)  # disabled
wbweave_3 = WeaverbirdsMeshFromLinesWeaveBack(Lines=crv_12, MaximumValence=4)  # disabled
wbvertices = WeaverbirdsVerticesComponent(MeshClosedPolylinesGroup=wbweave_3, Weld=True)  # disabled
demesh_4 = DeconstructMesh(Mesh=wbweave_3)  # -> Vertices, Faces, Colours, Normals; disabled
unifynormals = MeshUnifyNormals(Mesh=wbweave_2)  # disabled

crv_cp_2 = CurveClosestPoint(Point=wbvertices, Curve=crv_7)  # -> Point, Parameter, Distance; disabled
# 3b
dist_2 = Distance(PointA=wbvertices, PointB=crv_cp_2.Point)  # disabled
sort_2 = SortList(Keys=dist_2)  # -> Keys, ValuesA; disabled
item_12 = ListItem(List=sort_2.Keys, Index=0, Wrap=True)  # disabled
item_13 = ListItem(List=sort_2.Keys, Index=-1, Wrap=True)  # disabled
dom_2 = ConstructDomain(DomainStart=item_12, DomainEnd=item_13)  # disabled
panel_9 = Panel("0 to 1")  # disabled
remap_2 = RemapNumbers(Value=dist_2, Source=dom_2, Target=panel_9)  # -> Mapped, Clipped; disabled
graph = GraphMapper(
    remap_2.Mapped,
    x0=0,
    x1=1,
    y0=0,
    y1=1,
    container_name="Bezier",
    cpx=[0, 0.5474452376, 0.4715335667, 1],
    cpy=[0.08695650101, 0.2608695626, 0.5797101259, 0.3130431175])  # disabled
# distance from border and
# function manipulation
number_slider_11 = Slider(60, range=0..100)  # disabled
multiplication_2 = Multiplication(A=graph, B=number_slider_11)  # disabled

number_slider_12 = Slider(3500, range=0..10000)  # disabled
number_slider_13 = Slider(1, range=0..10)  # disabled

# ----
# make sides for a deeper panel
number_slider_14 = Slider(-5, range=-100..0)  # disabled
mesh_2 = Mesh(del)  # disabled
Z_3 = UnitZ(Factor=number_slider_14)  # disabled
move_3 = Move(Geometry=mesh_2, Motion=Z_3)  # -> Geometry, Transform; disabled
mesh_edges = MeshEdges(Mesh=mesh_2)  # -> NakedEdges, InteriorEdges, NonManifoldEdges; disabled
mesh_edges_2 = MeshEdges(Mesh=move_3.Geometry)  # -> NakedEdges, InteriorEdges, NonManifoldEdges; disabled
data = Data(mesh_edges.NakedEdges)  # disabled
data_2 = Data(mesh_edges_2.NakedEdges)  # disabled
end_points = EndPoints(Curve=data)  # -> Start, End; disabled
end_points_2 = EndPoints(Curve=data_2)  # -> Start, End; disabled
merge_5 = Merge(
    Data1=simplify(graft(end_points_2.Start)),
    Data2=simplify(graft(end_points_2.End)),
    Data3=simplify(graft(end_points.End)),
    Data4=simplify(graft(end_points.Start)))  # disabled
construct_mesh = ConstructMesh(Vertices=merge_5, Faces={A=0, B=1, C=2, D=3})  # disabled

# ----
# 3a
# Read the file of Initial Exported Image
panel_10 = Panel(panel_5)  # disabled
crv_13 = Curve(<curve referenced from the Rhino model>)  # disabled
img_2 = ImportImage(File=panel_10, Rectangle=crv_13)  # disabled
demesh_5 = DeconstructMesh(Mesh=img_2)  # -> Vertices, Faces, Colours, Normals; disabled
panel_11 = Panel("0 to 255")  # disabled
# find the 8 neighbors of each skeleton
# point to get an average color value
panel_12 = Panel("10 to 60")  # disabled

number_slider_15 = Slider(8, range=0..10)  # disabled
# find the 8 neighbors of each skeleton
# point to get an average color value
cps = ClosestPoints(Point=graft(wbvertices), Cloud=demesh_5.Vertices, Count=number_slider_15)  # -> ClosestPoint, CPIndex, Distance; disabled
item_14 = ListItem(List=demesh_5.Colours, Index=cps.CPIndex, Wrap=True)  # disabled
avr = Average(Input=item_14)  # -> flatten(ArithmeticMean); disabled

# ----
# Move according to mesh colours
argb = SplitARGB(Colour=avr, IntegerChannels=True)  # -> Alpha, Red, Green, Blue; disabled
remap_3 = RemapNumbers(Value=argb.Red, Source=panel_11, Target=panel_12)  # -> Mapped, Clipped; disabled

# ----
# move points of skeleton according to specific values
Z_4 = UnitZ(Factor=remap_3.Mapped)  # disabled
number_slider_16 = Slider(4, range=0..10)  # disabled
move_4 = Move(Geometry=wbvertices, Motion=flatten(Z_4))  # -> Geometry, Transform; disabled
cps_2 = ClosestPoints(Point=graft(move_4.Geometry), Cloud=move_4.Geometry, Count=number_slider_16)  # -> ClosestPoint, CPIndex, Distance; disabled
pdecon_2 = Deconstruct(Point=cps_2.ClosestPoint)  # -> XComponent, YComponent, ZComponent; disabled
avr_2 = Average(Input=pdecon_2.ZComponent)  # -> simplify(ArithmeticMean); disabled
pdecon_3 = Deconstruct(Point=move_4.Geometry)  # -> XComponent, YComponent, ZComponent; disabled
pt_4 = ConstructPoint(XCoordinate=pdecon_3.XComponent, YCoordinate=pdecon_3.YComponent, ZCoordinate=flatten(avr_2))  # disabled
conmesh_2 = ConstructMesh(Vertices=pt_4, Faces=demesh_4.Faces)  # disabled

# ----
# 4
mesh_3 = Mesh(wbweave_3)  # disabled
mesh_edges_3 = MeshEdges(Mesh=mesh_3)  # -> NakedEdges, InteriorEdges, NonManifoldEdges; disabled
# Construct the sides of  the  extrusion
mesh_edges_4 = MeshEdges(Mesh=conmesh_2)  # -> NakedEdges, InteriorEdges, NonManifoldEdges; disabled
data_3 = Data(mesh_edges_3.NakedEdges)  # disabled
data_4 = Data(mesh_edges_4.NakedEdges)  # disabled
end_points_3 = EndPoints(Curve=data_3)  # -> Start, End; disabled
end_points_4 = EndPoints(Curve=data_4)  # -> Start, End; disabled
merge_6 = Merge(
    Data1=simplify(graft(end_points_4.Start)),
    Data2=simplify(graft(end_points_4.End)),
    Data3=simplify(graft(end_points_3.End)),
    Data4=simplify(graft(end_points_3.Start)))  # disabled
construct_mesh_2 = ConstructMesh(Vertices=merge_6, Faces={A=0, B=1, C=2, D=3})  # disabled

mesh_join = MeshJoin(Meshes=flatten([conmesh_2, construct_mesh_2, unifynormals]))  # disabled
mshreduce = MeshReduce(Mesh=mesh_join, TargetSize=number_slider_12, Distort=True, Accuracy=5, NormalizeSize=False)  # disabled
wbblur = WeaverbirdsBlurMesh(MeshCurves=mesh_join, Level=number_slider_13, Thin=1)  # disabled

number_slider_17 = Slider(2, range=0..10)  # disabled
number_slider_18 = Slider(0, range=0..100)  # disabled
mesh_4 = Mesh(mshreduce)  # disabled
weaverbird_s_catmull_clark_subdivision = WeaverbirdsCatmullClarkSubdivision(MeshCurves=mesh_4, Level=number_slider_17, SmoothNakedEdges=number_slider_18)  # disabled
previewmat = CustomPreviewMaterials(Geometry=weaverbird_s_catmull_clark_subdivision, DiffuseColor=RGB(255, 255, 255))  # disabled
tri = Triangulate(Mesh=weaverbird_s_catmull_clark_subdivision)  # -> Mesh, Count; disabled
unifynormals_2 = MeshUnifyNormals(Mesh=tri.Mesh)  # disabled
demesh_6 = DeconstructMesh(Mesh=unifynormals_2)  # -> Vertices, Faces, Colours, Normals; disabled
panel_13 = Panel("1 to 3")  # disabled
panel_14 = Panel("0.5 to 3.5")  # disabled

Z_5 = UnitZ(Factor=1)  # disabled
# discretize  faces according to their horizontality
number_slider_19 = Slider(25, range=0..100)  # disabled
angle = Angle(VectorA=demesh_6.Normals, VectorB=Z_5)  # -> Angle, Reflex; disabled
deg = Degrees(Radians=angle.Angle)  # disabled
smaller_3 = SmallerThan(FirstNumber=deg, SecondNumber=number_slider_19)  # -> SmallerThan, OrEqualTo; disabled
dispatch_3 = Dispatch(List=demesh_6.Faces, DispatchPattern=smaller_3.SmallerThan)  # -> ListA, ListB; disabled

# ----
# OPTIONAL EXPLORATIONS
deface_3 = DeconstructFace(Face=dispatch_3.ListB)  # -> CornerA, CornerB, CornerC, CornerD; disabled
index = ItemIndex(List=demesh_6.Faces, Item=dispatch_3.ListB)  # disabled
panel_15 = Panel(index)  # disabled
item_15 = ListItem(List=demesh_6.Vertices, Index=deface_3.CornerA, Wrap=True)  # disabled
item_16 = ListItem(List=demesh_6.Vertices, Index=deface_3.CornerB, Wrap=True)  # disabled
item_17 = ListItem(List=demesh_6.Vertices, Index=deface_3.CornerC, Wrap=True)  # disabled
ln_7 = Line(StartPoint=item_16, EndPoint=item_17)  # -> graft(Line); disabled
ln_8 = Line(StartPoint=item_17, EndPoint=item_15)  # -> graft(Line); disabled
ln_9 = Line(StartPoint=item_15, EndPoint=item_16)  # -> graft(Line); disabled
join_2 = JoinCurves(Curves=[ln_9, ln_7, ln_8], Preserve=False)  # disabled
area = Area(Geometry=flatten(join_2))  # -> Area, Centroid; disabled
sort_3 = SortList(Keys=area.Area)  # -> Keys, ValuesA; disabled
item_18 = ListItem(List=sort_3.Keys, Index=0, Wrap=True)  # disabled
item_19 = ListItem(List=sort_3.Keys, Index=-1, Wrap=True)  # disabled
dom_3 = ConstructDomain(DomainStart=item_18, DomainEnd=item_19)  # disabled
remap_4 = RemapNumbers(Value=area.Area, Source=dom_3, Target=panel_14)  # -> Mapped, Clipped; disabled
remap_5 = RemapNumbers(Value=area.Area, Source=dom_3, Target=panel_13)  # -> Mapped, Clipped; disabled
int = Integer(remap_5.Mapped)  # disabled
m_branch = Branch(G=unifynormals_2, L=int, D0=remap_4.Mapped, XD0=1, D1=0, XD1=1, t0=0.25, X0=1, t1=0.5, X1=1)  # -> out, A; inputs G: GeometryBase, I: list, L: list, D0: list, XD0: list, D1: list, XD1: list, t0: list, X0: list, t1: list, X1: list, clr: list of Color; disabled
# ---------- m_branch: VB ----------
    Component.Params.Input(0).Name = "Mesh or Curve"
    Component.Params.Input(0).Description = "Open or closed mesh or curve"
    Component.Params.Input(1).Name = "Index [Face]"
    Component.Params.Input(1).Description = "An optional index or list of indices which specify which faces are to be modified. If empty, all faces will be used"
    Component.Params.Input(2).Name = "Loops [Face]"
    Component.Params.Input(2).Description = "An optional list of integer values which sets the number of iterative operations to be applied to each face"
    Component.Params.Input(3).Name = "Distance [Face, Rh Units]"
    Component.Params.Input(3).Description = "An optional list of double values which sets the depth the new geometry will be offset from the original face"
    Component.Params.Input(4).Name = "Multiplier [Face]"
    Component.Params.Input(4).Description = "An optional list of double values which is a per loop multiplier for the Distance value"
    Component.Params.Input(5).Name = "Center Offset[Face, Rh Units]"
    Component.Params.Input(5).Description = "An optional list of double values which sets the depth the midpoint of the new geometry will be offset from the original face"
    Component.Params.Input(6).Name = "Multiplier [Face]"
    Component.Params.Input(6).Description = "An optional list of double values which is a per loop multiplier for the Center Offset value"
    Component.Params.Input(7).Name = "Scale [Face]"
    Component.Params.Input(7).Description = "An optional list of double values which sets the scale factor for the top of the new branch"
    Component.Params.Input(8).Name = "Multiplier [Face]"
    Component.Params.Input(8).Description = "An optional list of double values which is a per loop multiplier for the Face Scale value"
    Component.Params.Input(9).Name = "Splay [Face]"
    Component.Params.Input(9).Description = "An optional list of double values which shifts the peak from the face center toward the associated vertex"
    Component.Params.Input(10).Name = "Multiplier [Face]"
    Component.Params.Input(10).Description = "An optional list of double values which is a per loop multiplier for the Splay value"
    Component.Params.Input(11).Name = "Colors [Vertex]"
    Component.Params.Input(11).Description = "(If applied to a mesh a list of colors corresponding to each mesh face, if applied to a curve, a list of colors corresponding to each control point plus an additonal color value for the new averaged center"

    Component.Params.Output(1).Name = "Mesh"
    Component.Params.Output(1).Description = "If successful, a valid mesh"

    If g IsNot Nothing Then

      Dim j,k,kk,n,t,tt,v,w,Lt,lp,cnt As Integer
      Dim arrL() As Integer
      Dim ob As New list(Of Boolean)
      arrL = L.toarray()
      array.Sort(arrL)
      Lt = arrL(ubound(arrL))

      For lp = 0 To Lt Step 1
        Dim u() As Integer = Nothing
        Dim tint() As Integer = Nothing
        Dim mo As New mesh
        Dim ov,cv As New list(Of Point3d)
        Dim ofc As New list(Of meshface)
        Dim ofb As New list(Of Boolean)
        Dim oc As New list(Of color)

        Dim otx0, otx1, odtx0, odtx1, ot0, ot1, od0, od1 As New list(Of Double)
        Dim oL As New list(Of Integer)

        Dim blnM, blnC As Boolean

        Dim cen As point3d
        Dim vec As Vector3d
        Dim clrB As Boolean
        Dim avgClr,avgClrC As color

        blnM = g.ObjectType = ObjectType.Mesh
        blnC = g.ObjectType = ObjectType.Curve

        'Declare Mesh Variables
        Dim m As New mesh
        Dim mf As Rhino.Geometry.Collections.MeshFaceList = Nothing
        Dim mv As Rhino.Geometry.Collections.MeshVertexList = Nothing
        Dim mtv As Rhino.Geometry.Collections.MeshTopologyVertexList = Nothing
        Dim mn As Rhino.Geometry.Collections.MeshFaceNormalList = Nothing
        Dim mc As Rhino.Geometry.Collections.MeshVertexColorList

        'Declare Curve Variables
        Dim crv As curve
        Dim ncrv As nurbsCurve
        Dim npts As rhino.Geometry.Collections.NurbsCurvePointList
        Dim vs() As vector3f

        If (blnM Or blnC) Then

          If blnM Then
            'Start Deconstruct if Mesh
            m = g
            m.Normals.ComputeNormals()
            m.FaceNormals.ComputeFaceNormals()
            mf = m.Faces
            mv = m.Vertices
            mtv = m.TopologyVertices
            mn = m.FaceNormals
            mc = m.VertexColors

            'Check Mesh Color Status
            If ((m.VertexColors.count() <> 0) Or (clr.count() <> 0)) Then clrB = True
            If ((m.VertexColors.count() = 0) And (clr.count() <> 0)) Then mc.CreateMonotoneMesh(color.LightGray)

            'Populate Vertex/ Color Lists
            ov = mv.ToPoint3dArray().ToList()
            oc = mc.ToArray().ToList()

          Else
            'Start Deconstruct if Curve
            crv = g
            ncrv = crv.ToNurbsCurve()
            npts = ncrv.Points
            Dim pline As Polyline = ncrv.Points.ControlPolygon
            Dim cmsh As New mesh
            cmsh.Vertices.AddVertices(pline.ToArray())
            cmsh.faces.addfaces(pline.TriangulateClosedPolyline())
            cmsh.Vertices.Remove(pline.count() - 1, True)
            cmsh.Normals.ComputeNormals()
            cmsh.Normals.UnitizeNormals

            ov = pline.ToArray().ToList()
            If crv.IsClosed() Then ov.RemoveAt(pline.count() - 1)
            cv = pline.ToArray().ToList()
            If crv.IsClosed() Then cv.RemoveAt(pline.count() - 1)

            v = ov.Count() - 1
            If Not crv.IsClosed() Then v += 1
            u = appendprepend(v)
            w = v
            vs = cmsh.Normals.ToArray()

            For j = 0 To v Step 1
              vec += vs(u(j))
              If (clr.count() > 0) Then If j > (clr.count() - 1) Then oc.add(clr.item(clr.count() - 1)) Else oc.add(clr.item(j))
            Next
            vec /= v
            vec.Unitize
            cen = pline.CenterPoint
          End If

          'Check clr input status
          If clr.count() <> 0 Then clrB = True

        End If

        If lp = 0 Then
          If blnM Then If i.count() > 0 Then cnt = i.count() Else cnt = mf.count() Else cnt = 1
          For n = 0 To cnt - 1 Step 1
            ob.add(True)
          Next
        Else
          cnt = mf.count()
        End If

        'Begin to Iterate Through Faces
        For n = 0 To cnt - 1 Step 1

          If blnM Then
            If lp = 0 Then If i.count() > 0 Then j = i.item(n) Else j = n Else j = n

            tint = mf.GetTopologicalVertices(j)
            cen = mf.GetFaceCenter(j)
            vec = mn.item(j)

            If mf(j).isquad() Then v = 3 Else v = 2
            u = appendprepend(v)
          Else
            j = n
          End If
          vec.Unitize()

          If ((lp = 0) Or (ob.item(n))) Then

            Dim la,da0,da1,ta0,ta1,tXd0,tXd1,tx0,tx1 As Double

            If j > (L.count() - 1) Then la = L.item(L.count() - 1) Else la = L.item(j)

            If j > (d0.count() - 1) Then da0 = d0.item(d0.count() - 1) Else da0 = d0.item(j)
            If j > (d1.count() - 1) Then da1 = d1.item(d1.count() - 1) Else da1 = d1.item(j)

            If j > (Xd0.count() - 1) Then tXd0 = Xd0.item(Xd0.count() - 1) Else tXd0 = Xd0.item(j)
            If j > (Xd1.count() - 1) Then tXd1 = Xd1.item(Xd1.count() - 1) Else tXd1 = Xd1.item(j)

            If j > (t0.count() - 1) Then ta0 = t0.item(t0.count() - 1) Else ta0 = t0.item(j)
            If j > (t1.count() - 1) Then ta1 = t1.item(t1.count() - 1) Else ta1 = t1.item(j)

            If j > (x0.count() - 1) Then tx0 = x0.item(x0.count() - 1) Else tx0 = x0.item(j)
            If j > (x1.count() - 1) Then tx1 = x1.item(x1.count() - 1) Else tx1 = x1.item(j)

            If clrB Then
              Dim tv As Integer
              Dim aR,aG,aB,bR,bG,bB As New Double
              For k = 0 To v Step 1
                If blnM Then tv = mtv.MeshVertexIndices(tint(k))(0) Else tv = k
                aR += oc.item(tv).R
                aG += oc.item(tv).G
                aB += oc.item(tv).B
                If ((lp = 0) And (clr.count() > 0)) Then
                  If tv > (clr.count() - 1) Then tv = clr.count() - 1
                  bR += clr.item(tv).R
                  bG += clr.item(tv).G
                  bB += clr.item(tv).B
                End If
              Next

              If (blnM Or ((clr.count() - 1) <= v)) Then avgClr = avgC(aR, aG, aB, v + 1) Else avgClr = clr.item(clr.count() - 1)
              If (blnM Or ((clr.count() - 1) <= v)) Then avgClrC = avgC(bR, bG, bB, v + 1) Else avgClrC = clr.item(clr.count() - 1)
            End If

            w = ov.count() - 1
            t = 2

            Dim vA As vector3d
            If lp = 0 Then va = New vector3d(0, 0, 0) Else va = (mv.item(mtv.MeshVertexIndices(tint(0))(0)) - cen) * ta1

            For k = 1 To v + 1  Step 1
              'Keep distance and t values from exceeding list lengths
              Dim p(2) As point3d
              Dim tv(2) As Integer

              For kk = 0 To 2 Step 1
                If blnM Then
                  tv(kk) = mtv.MeshVertexIndices(tint(u(k + kk - 1)))(0)
                  p(kk) = New point3d(mv(tv(kk)))
                Else
                  tv(kk) = u(k + kk - 1)
                  p(kk) = New point3d(ov(tv(kk)))
                End If
              Next

              'Define Vertices
              Dim pA,pB,pC As point3d
              pA = (p(1) + p(2)) / 2
              pB = evalP(p(1), cen, ta0)
              pC = evalP(pA, cen, ta0)

              ov.add(pB + vec * (da0 - da1) + va)
              ov.add(pC + vec * da0 + va)
              If clrB Then oc.add(evalC(oc.item(tv(1)), avgClr, ta0))
              If clrB Then oc.add(evalC(evalC(oc.item(tv(1)), oc.item(tv(2)), 0.5), avgClr, ta0))

              'Define Faces
              ofc.Add(New meshface(tv(1), w + u(k) * t + 2, w + u(k) * t + 1))
              ofc.Add(New meshface(tv(1), tv(2), w + u(k) * t + 2))
              ofc.Add(New meshface(tv(2), w + u(k + 1) * t + 1, w + u(k) * t + 2))
              ofc.Add(New meshface(w + u(k) * t + 1, w + u(k) * t + 2, w + (v + 1) * t + 1, w + u(k - 1) * t + 2))

              For kk = 0 To 3 Step 1
                oL.add(la)
                If kk = 3 Then If Lp >= La Then ofb.add(False) Else ofb.add(True) Else ofb.add(False)
                od0.add(da0 * txd0)
                od1.add(da1 * txd1)
                odtx0.add(txd0)
                odtx1.add(txd1)
                ot0.add(ta0 * tx0)
                ot1.add(ta1 * tx1)
                otx0.add(tx0)
                otx1.add(tx1)
              Next
              tt = 4

            Next
            ov.add(cen + vec * (da0 + da1) + va)
            If clrB Then If((lp = 0) And ( clr.count() > 0)) Then oc.add(avgClrC) Else oc.add(avgClr)
          Else
            ofc.Add(mf.item(j))
            oL.add(L.item(j))
            ofb.add(False)
            od0.add(d0.item(j))
            od1.add(d1.item(j))
            odtx0.add(Xd0.item(j))
            odtx1.add(Xd1.item(j))
            ot0.add(t0.item(j))
            ot1.add(t1.item(j))
            otx0.add(x0.item(j))
            otx1.add(x1.item(j))

          End If
        Next

        mo = New mesh

        mo.Vertices.AddVertices(ov.toarray())
        If clrB Then mo.VertexColors.AppendColors(oc.toarray())
        mo.Faces.AddFaces(ofc.toarray())
        mo.FaceNormals.ComputeFaceNormals()
        mo.Normals.ComputeNormals()

        L = oL
        ob = ofb
        D0 = od0
        D1 = od1
        XD0 = odtx0
        XD1 = odtx1
        t0 = ot0
        t1 = ot1
        X0 = otx0
        X1 = otx1
        G = mo

        A = mo
      Next

    End If
# ---------- m_branch: VB additional code ----------
  Private Function appendprepend(ByVal i As Integer)
    Dim srsEnum As IEnumerable(Of Integer) = Enumerable.Range(0, i + 1)
    Dim arrVal As New list(Of Integer)
    arrVal = srsEnum.tolist()
    arrVal.add(0)
    arrVal.insert(0, i)
    Return arrVal.toarray()
  End Function

  Private Function evalP(ByVal op As point3d, ByVal tp As Point3d, ByVal t As Double)

    Return New point3d(op + (tp - op) * t)
  End Function

  Private Function evalC(ByVal oc As color, ByVal tc As color, ByVal t As Double)
    Dim r,g,b As Integer
    r = CInt(CInt(oc.R) + (CInt(tc.R) - CInt(oc.R)) * t)
    g = CInt(CInt(oc.G) + (CInt(tc.G) - CInt(oc.G)) * t)
    b = CInt(CInt(oc.B) + (CInt(tc.B) - CInt(oc.B)) * t)

    If r > 255 Then r = 255 Else If r < 0 Then r = 0
    If g > 255 Then g = 255 Else If g < 0 Then g = 0
    If b > 255 Then b = 255 Else If b < 0 Then b = 0

    Return color.FromArgb(r, g, b)
  End Function

  Private Function avgC(ByVal R As Double, ByVal G As Double, ByVal B As Double, ByVal T As Integer)

    R /= t
    G /= t
    B /= t
    If R > 255 Then R = 255 Else If R < 0 Then R = 0
    If G > 255 Then G = 255 Else If G < 0 Then G = 0
    If B > 255 Then B = 255 Else If B < 0 Then B = 0

    Return color.FromArgb(CInt(R), CInt(G), CInt(B))
  End Function
# ---------- end m_branch ----------
wbjoin = WeaverbirdsJoinMeshesAndWeld(Mesh=flatten([construct_mesh, move_3.Geometry, m_branch.A]), Weld=False)  # disabled
previewmat_2 = CustomPreviewMaterials(Geometry=m_branch.A, DiffuseColor=RGB(255, 255, 255))  # disabled
previewmat_3 = CustomPreviewMaterials(Geometry=wbjoin, DiffuseColor=RGB(255, 255, 255))  # disabled

# ==== cluster Cluster
fe = ClusterInput()
D = ClusterInput()
_2d_mesh_results = _2DMeshResults(FEModel=fe, Deflection=D, ColorMode=0)
mesh = ClusterOutput(_2d_mesh_results)
